# Grasshopper definition Snitch.gh (Grasshopper 1.0.7)
# plug-ins: Grasshopper-Tekla Link 2021.1.14, jSwan, Heteroptera, SnitchGrasshopper, Wombat, Kangaroo2 Components, Pufferfish

model_object = ModelObject(
    [null x357],
    ModelID="Snitch.db1",
    ModelObjectInfos=["Tekla.Structures.Model.Assembly, Tekla.Structures.Model, Version=2021.0.0.0, Culture=neutral, PublicKeyToken=2f04dbe497b71114;ceaf813d-2108-4978-8317-5331f896f2aa", "Tekla.Structures.Model.Assembly, Tekla.Structures.Model, Version=2021.0.0.0, Culture=neutral, PublicKeyToken=2f04dbe497b71114;79bf72ab-b9d2-4379-a616-17502ba0fac2", "Tekla.Structures.Model.Assembly, Tekla.Structures.Model, Version=2021.0.0.0, Culture=neutral, PublicKeyToken=2f04dbe497b71114;9f1725af-8c8d-4112-9718-4f1bc0af24a4", "Tekla.Structures.Model.Assembly, Tekla.Structures.Model, Version=2021.0.0.0, Culture=neutral, PublicKeyToken=2f04dbe497b71114;63d2c16a-5575-4e79-a34c-2ebacfda0772", "Tekla.Structures.Model.Assembly, Tekla.Structures.Model, Version=2021.0.0.0, Culture=neutral, PublicKeyToken=2f04dbe497b71114;695cecea-abe4-41b6-9efa-eb5d9f6c383e", "Tekla.Structures.Model.Assembly, Tekla.Structures.Model, Version=2021.0.0.0, Culture=neutral, PublicKeyToken=2f04dbe497b71114;d0cc52ad-5c2c-4706-b179-5e253ecd1f28"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])
model_object_2 = ModelObject(simplify(graft(model_object)))
deconstruct_assembly = DeconstructAssembly(Assembly=model_object_2)  # -> Name, Type, MainPart, Secondaries, AllObjects
shift_paths = ShiftPaths(Data=deconstruct_assembly.AllObjects, Offset=-1)
clean_tree = CleanTree(RemoveNulls=True, RemoveInvalid=True, RemoveEmpty=True, Tree=shift_paths)
cull_index = CullIndex(List=clean_tree, Indices="0", Wrap=True)
list_item = ListItem(List=clean_tree, Index="0", Wrap=True)

# ---- group: Rebars
rebar = Rebar(cull_index)
shift_paths_2 = ShiftPaths(Data=rebar, Offset=-1)
get_property = GetProperty(TeklaObject=shift_paths_2, Name="WEIGHT", Type=0)
shift_paths_3 = ShiftPaths(Data=get_property, Offset=-1)
mass_addition = MassAddition(Input=shift_paths_3)  # -> Result, PartialResults

# ---- group: Beam and columns
beam = Beam(list_item)
clean_tree_2 = CleanTree(RemoveNulls=True, RemoveInvalid=True, RemoveEmpty=True, Tree=beam)
convert_to_mesh = ConvertToMesh(TeklaObject=clean_tree_2, SolidType=2)
deconstruct_beam = DeconstructBeam(Beam=clean_tree_2)  # -> Curve, Profile, Attributes, Position, Numbering, Deforming, Type
expand_part_attributes = ExpandPartAttributes(Attributes=deconstruct_beam.Attributes)  # -> Name, Profile, Material, Finish, Class, Phase, UDA
control_points = ControlPoints(Curve=deconstruct_beam.Curve)  # -> Points, Weights, Knots
shift_paths_4 = ShiftPaths(Data=convert_to_mesh, Offset=-1)
volume = Volume(Geometry=shift_paths_4)  # -> expr("x*10^-6", Volume), Centroid
match_text = MatchText(Text=deconstruct_beam.Type, Pattern="BEAM", Case=True)
match_text_2 = MatchText(Text=deconstruct_beam.Type, Pattern="COLUMN", Case=True)
shift_paths_5 = ShiftPaths(Data=control_points.Points, Offset=-1)
dispatch = Dispatch(List=deconstruct_beam.Curve, DispatchPattern=match_text)  # -> ListA, ListB
tree_statistics = TreeStatistics(Tree=dispatch.ListA)  # -> Paths, Length, Count
dispatch_2 = Dispatch(List=volume.Volume, DispatchPattern=match_text_2)  # -> ListA, ListB
dispatch_3 = Dispatch(List=expand_part_attributes.Material, DispatchPattern=match_text_2)  # -> ListA, ListB
dispatch_4 = Dispatch(List=shift_paths_4, DispatchPattern=match_text)  # -> ListA, ListB
dispatch_5 = Dispatch(List=deconstruct_beam.Curve, DispatchPattern=match_text_2)  # -> ListA, ListB
tree_statistics_2 = TreeStatistics(Tree=dispatch_5.ListA)  # -> Paths, Length, Count
dispatch_6 = Dispatch(List=shift_paths_4, DispatchPattern=match_text_2)  # -> ListA, ListB
dispatch_7 = Dispatch(List=volume.Volume, DispatchPattern=match_text_2)  # -> ListA, ListB
dispatch_8 = Dispatch(List=volume.Volume, DispatchPattern=match_text)  # -> ListA, ListB
dispatch_9 = Dispatch(List=expand_part_attributes.Material, DispatchPattern=match_text)  # -> ListA, ListB
dispatch_10 = Dispatch(List=volume.Volume, DispatchPattern=match_text)  # -> ListA, ListB
tree_branch = TreeBranch(Tree=mass_addition.Result, Path=tree_statistics_2.Paths, MaintainPaths=True)
tree_branch_2 = TreeBranch(Tree=mass_addition.Result, Path=tree_statistics.Paths, MaintainPaths=True)
panel = Panel("50")
snitch_beam = SnitchBeam(
    Mesh=dispatch_4.ListA,
    Polyline=dispatch.ListA,
    ConcreteVolume=dispatch_8.ListA,
    SteelMass=tree_branch_2,
    ConcreteClass=dispatch_9.ListA,
    Load="40")

# ----
longest_list = LongestList(ListA=dispatch_6.ListA, ListB=panel, PaddingMode=2)  # -> ListA, flatten(ListB)
randomize_numbers = RandomizeNumbers(Number=longest_list.ListB, Ratio=0.2)
unflatten_tree = UnflattenTree(Tree=randomize_numbers, Guide=longest_list.ListA)
snitch_column = SnitchColumn(
    Mesh=dispatch_6.ListA,
    Polyline=dispatch_5.ListA,
    ConcreteVolume=dispatch_7.ListA,
    SteelMass=tree_branch,
    ConcreteClass=dispatch_3.ListA,
    Load=unflatten_tree)

# ---- group: Slabs
plate = Plate(list_item)
clean_tree_3 = CleanTree(RemoveNulls=True, RemoveInvalid=True, RemoveEmpty=True, Tree=plate)
convert_to_mesh_2 = ConvertToMesh(TeklaObject=clean_tree_3, SolidType=2)
deconstruct_plate = DeconstructPlate(Plate=clean_tree_3)  # -> Boundary, Profile, Attributes, Position, Numbering, Type
expand_part_attributes_2 = ExpandPartAttributes(Attributes=deconstruct_plate.Attributes)  # -> Name, Profile, Material, Finish, Class, Phase, UDA
control_points_2 = ControlPoints(Curve=deconstruct_plate.Boundary)  # -> Points, Weights, Knots
shift_paths_6 = ShiftPaths(Data=convert_to_mesh_2, Offset=-1)
panel_2 = Panel("PLATE")
volume_2 = Volume(Geometry=shift_paths_6)  # -> expr("x*10^-6", Volume), Centroid
shift_paths_7 = ShiftPaths(Data=control_points_2.Points, Offset=-1)
panel_3 = Panel("1")
tree_statistics_3 = TreeStatistics(Tree=volume_2.Volume)  # -> Paths, Length, Count
tree_branch_3 = TreeBranch(Tree=mass_addition.Result, Path=tree_statistics_3.Paths, MaintainPaths=True)

# ---- group: Voronoi
curve = Curve(deconstruct_plate.Boundary)
end_points = EndPoints(Curve=deconstruct_beam.Curve)  # -> Start, End
c_script = CSharpScript(curves=flatten(curve))  # -> graft(A); inputs curves: list of Curve
# ---------- c_script: C# ----------
    List<helper> newCurves = new List<helper>();
    
    foreach (var curve in curves)
    {
      Plane normal;
      curve.TryGetPlane(out normal, 0.001);
      if (normal.ZAxis.Z > 0.9)
      {
        newCurves.Add(new helper(){curve = curve, Ele = normal.Origin.Z});
      }
       
    }
    newCurves.Sort((x,y) => x.Ele.CompareTo(y.Ele));
    List<Curve> final = new List<Curve>();
    foreach (var item in newCurves)
    {
      final.Add(item.curve);
    }
    A = final;
# ---------- c_script: C# additional code ----------
  public class helper
  {
    public double Ele {get;set;}
    public Curve curve {get;set;}
  }
# ---------- end c_script ----------
boundary_surfaces = BoundarySurfaces(Edges=c_script)
removeduplicatepts = RemoveDuplicatePts(Points=flatten([end_points.Start, end_points.End]), Tolerance=0.01)
brep_closest_point = BrepClosestPoint(Point=removeduplicatepts, Brep=boundary_surfaces)  # -> Point, Normal, Distance
equality = Equality(FirstNumber=simplify(brep_closest_point.Point), SecondNumber=2)  # -> Equality, Inequality
smaller_than = SmallerThan(FirstNumber=brep_closest_point.Distance, SecondNumber="10")  # -> SmallerThan, OrEqualTo
cull_pattern = CullPattern(List=removeduplicatepts, CullPattern=smaller_than.SmallerThan)  # -> simplify(List)
voronoi = Voronoi(Points=cull_pattern, BruteForceOverride=False)
merge = Merge(Data1=simplify(c_script), Data2=simplify(voronoi))
is_planar = IsPlanar(Surface=boundary_surfaces, Interior=True)  # -> Planar, Plane
panel_4 = Panel(cull_pattern)
region_intersection = RegionIntersection(CurvesA=simplify(c_script), CurvesB=simplify(voronoi), Plane=is_planar.Plane)
region_union = RegionUnion(Curves=merge)
trim_with_region = TrimWithRegion(Curve=simplify(voronoi), Region=simplify(c_script))  # -> Inside, Outside
shift_paths_8 = ShiftPaths(Data=trim_with_region.Inside, Offset=-1)
curve_2 = Curve(shift_paths_8)
close_curve = CloseCurve(Curve=curve_2, CloseType=0, Bulge=0.5, Tolerance=0)  # -> Closed, ResultBoolean

# ----
longest_list_2 = LongestList(ListA=tree_branch_3, ListB="2", PaddingMode=2)  # -> ListA, flatten(ListB)
randomize_numbers_2 = RandomizeNumbers(Number=longest_list_2.ListB, Ratio=0.2)
unflatten_tree_2 = UnflattenTree(Tree=randomize_numbers_2, Guide=longest_list_2.ListA)

# ---- group: Slabs (continued)
snitch_slab = SnitchSlab(
    Mesh=shift_paths_6,
    Polyline=deconstruct_plate.Boundary,
    ConcreteVolume=volume_2.Volume,
    SteelMass=tree_branch_3,
    ConcreteClass=expand_part_attributes_2.Material,
    Thickness=expand_part_attributes_2.Profile,
    Load=unflatten_tree_2)

# ----
merge_2 = Merge(Data1=snitch_beam, Data2=snitch_column, Data3=snitch_slab)  # -> flatten(Result)
snitch_building = SnitchBuilding(ListOfBuildingObjects=merge_2, Voronois=close_curve.Closed)

# ---- group: Create JSON database
snitchobject = Data(snitch_building)
serialize_json = SerializeJson(SnitchObject=snitchobject, IncludeNullAndEmptyProperties=False)  # disabled
serialize_json_2 = SerializeJson(Building=snitchobject, IncludeNullAndEmptyProperties=False)
text_join = TextJoin(Text=serialize_json, Join=",")
create_json = BooleanToggle(False)
c_script_2 = CSharpScript()  # -> CurrentFolder
# ---------- c_script_2: C# usings ----------
using System.IO;
# ---------- c_script_2: C# ----------
    CurrentFolder = Path.GetDirectoryName(GrasshopperDocument.FilePath) + Path.DirectorySeparatorChar;
# ---------- end c_script_2 ----------
deserialize_json = DeserializeJson(JSON=serialize_json_2, OutputsLocked=False)
concatenate = Concatenate(FragmentA=c_script_2, FragmentB="Database2.json")
concatenate_2 = Concatenate(FragmentA="[", FragmentB=text_join, FragmentC="]")
write_to_text_file = WriteToTextFile(Run=create_json, TextToWrite=deserialize_json, FilePath=concatenate, Append=Toggle(False), NewOnly=False)
panel_5 = Panel(write_to_text_file)

# ----
analyze_snitch_building = AnalyzeSnitchBuilding(Building=snitch_building)
expand_object = ExpandObject(Object=analyze_snitch_building)  # -> Beams, BuildingObjectsList, CO2, CO2_beams, CO2_columns, CO2_slabs, CO2_total, CO2_walls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
expand_object_2 = ExpandObject(Object=expand_object.Columns)  # -> Key, Value
expand_object_3 = ExpandObject(Object=expand_object.Slabs)  # -> Key, Value
expand_object_4 = ExpandObject(Object=expand_object_2.Value)  # -> CenterLine, CO2, ConcreteClass, FloorNo, G, Guid, Height, LoadBearingArea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
expand_object_5 = ExpandObject(Object=expand_object_3.Value)  # -> Boundary, CO2, ConcreteClass, FloorNo, G, Guid, Load, Mass_steel_m3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
mesh = Mesh(expand_object_4.Mesh)
mesh_2 = Mesh(expand_object_5.Mesh)
gradient = Gradient(
    LowerLimit="0",
    UpperLimit="1",
    Parameter=expand_object_5.Score,
    stops=[0: RGB(0, 128, 0), 0.5: RGB(255, 255, 0), 1: RGB(255, 0, 0)])
gradient_2 = Gradient(
    LowerLimit="0",
    UpperLimit="1",
    Parameter=expand_object_4.Score,
    stops=[0: RGB(0, 128, 0), 0.5: RGB(255, 255, 0), 1: RGB(255, 0, 0)])
custom_preview = CustomPreview(Geometry=mesh_2, Material=gradient)
custom_preview_2 = CustomPreview(Geometry=mesh, Material=gradient_2)
