# Grasshopper definition Voronoi_tester.gh (Grasshopper 1.0.7)
# plug-ins: LunchBox, SnitchGrasshopper

pt = ConstructPoint(XCoordinate=0, YCoordinate=0, ZCoordinate=0)
pt_2 = ConstructPoint(XCoordinate="10000", YCoordinate=0, ZCoordinate=0)
pt_3 = ConstructPoint(XCoordinate="10000", YCoordinate="10000", ZCoordinate=0)
pt_4 = ConstructPoint(XCoordinate=0, YCoordinate="10000", ZCoordinate=0)
srf4pt = _4PointSurface(CornerA=pt, CornerB=pt_2, CornerC=pt_3, CornerD=pt_4)
crv = Curve(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)
grid = GridStructure(Surface=srf4pt, UDivisions=10, VDivisions=10)  # -> StructureLines, StructureNodes
snitch_voronoi = SnitchVoronoi(Points=grid.StructureNodes, BoarderPoints=crv)
